# Grasshopper definition a4.gh (Grasshopper 1.0.7)
# Copyright: 2022

a = GetNumber("2", AtLeast=1, AtMost=1, Maximum=1.797693135e+308, Minimum=-1.797693135e+308, TreeAccess=False)
b = GetNumber("2", AtLeast=1, AtMost=1, Maximum=1.797693135e+308, Minimum=-1.797693135e+308, TreeAccess=False)
c = GetNumber("2", AtLeast=1, AtMost=1, Maximum=1.797693135e+308, Minimum=-1.797693135e+308, TreeAccess=False)
addition = Addition(A=a, B=b)
multiplication = Multiplication(A=addition, B=c)
nk = NamaKomponen(a=multiplication, b="5.5")  # -> z
# ---------- nk: Python ----------
"""Keterangan
    Inputs:
        a: Keterangan input a : gunakan slider atau list
        b: Keterangan input b
    Output:
        x: Keterangan output x
"""

__author__ = "Achmad Irsan"
__version__ = "2023.04.06"


#Nama komponen
ghenv.Component.Name = "Nama Komponen"
ghenv.Component.NickName = "Nk"

#import library
import rhinoscriptsyntax as rs
from Grasshopper.Kernel import GH_RuntimeMessageLevel as rml

#variabel
gca = ghenv.Component.AddRuntimeMessage
w = rml.Warning
e = rml.Error

pesan = " "
pesan1 = "peringatan 1"
pesan1a = "salah tipe file"
pesan2 = "peringatan 2"
ok1 = "OK 1"
ok2 = "OK 2"

if a == None:
    a=0
    gca(w, pesan1)
    p1=pesan1
elif type(a) == str:
    a=0
    gca(e, pesan1a)
    p1=pesan1a
else:
    p1=ok1


if b == None:
    b=0
    gca(w, pesan2)
    p2=pesan2
else:
    p2=ok2


pesan = [p1, p2]
z=a+b
# ---------- end nk ----------

# ---- group: RH_OUT:Hasil
num = Number(nk)

# ----
panel = Panel(nk)
